# Grasshopper definition Fuling Transit Hub.gh (Grasshopper 0.9.14)

# ---- group: Original Spacing Lines (12m o.c.)
crv = Curve([<curve referenced from the Rhino model> x43])

# ---- group: Grade along West side
srf = Surface(<surface referenced from the Rhino model>)
srf_2 = Surface(<surface referenced from the Rhino model>)
srf_3 = Surface(<surface referenced from the Rhino model>)

# ---- group: Vertical Offset along West side
int = Integer(600)

# ---- group: c_topguide (winning curve)
crv_2 = Curve(<curve referenced from the Rhino model>)

# ---- group: c_topguide (sweep rail)
crv_3 = Curve(<curve referenced from the Rhino model>)

# ---- group: Wide Flange Size
int_2 = Integer(893)
int_3 = Integer(406)

# ---- group: c_sweep1TR
srf_4 = Surface(<surface referenced from the Rhino model>)

# ---- group: c_sweep1
srf_5 = Surface(<surface referenced from the Rhino model>)

# ----
crv_4 = Curve([<curve referenced from the Rhino model> x2])
crv_5 = Curve(<curve referenced from the Rhino model>)
crv_6 = Curve([<curve referenced from the Rhino model> x32])
crv_7 = Curve([<curve referenced from the Rhino model> x28])
merge = Merge(Data1=crv_5, Data2=crv_6)
offset = Offset(Surface=srf_5, Distance=expr("D * 0.5", int_2), Retrim=True)
merge_2 = Merge(Data1=srf, Data2=srf_2, Data3=srf_3)  # -> flatten(Result); disabled
merge_3 = Merge(Data1=srf_5)  # disabled

# ---- group: Original Construction Curves
crv_8 = Curve(<curve referenced from the Rhino model>)
crv_9 = Curve(<curve referenced from the Rhino model>)
crv_10 = Curve(<curve referenced from the Rhino model>)
planar = Planar(Curve=crv_10)  # -> Planar, Plane, Deviation

# ----
project = Project(Geometry=merge, Plane=planar.Plane)  # -> Geometry, Transform
project_2 = Project(Geometry=crv_7, Plane=planar.Plane)  # -> Geometry, Transform

# ---- group: Original Spacing Lines (9m o.c.)
crv_11 = Curve([<curve referenced from the Rhino model> x59])
crv_12 = Curve(project.Geometry)
crv_13 = Curve(project_2.Geometry)

# ----
# TRANSITION FROM 9m TO 12m GRID SPACING
slider = Slider(2, range=-3..7)
lng = ListLength(List=crv_12)
series = Series(Start=0, Step=1, Count=slider)
item = ListItem(List=crv_12, Index=expr("i - 1", lng), Wrap=False)
item_2 = ListItem(List=crv_13, Index=series, Wrap=False)
int_4 = Integer([500, 1000])
dash = DashPattern(Curve=item_2, Pattern=int_4)  # -> Dashes, Gaps
end = EndPoints(Curve=item)  # -> Start, End
end_2 = EndPoints(Curve=item_2)  # -> Start, End
merge_4 = Merge(Data1=end.End, Data2=flatten(end_2.End))
shift = ShiftList(List=merge_4, Shift=1, Wrap=False)
dist = Distance(PointA=merge_4, PointB=shift)
ma = MassAddition(Input=dist)  # -> Result, PartialResults
y_range = Panel(ma.Result)

int_5 = Integer(1)
int_6 = Integer(1)
division = Division(A=int_5, B=slider)
addition = Addition(A=slider, B=int_6)
series_2 = Series(Start=0, Step=division, Count=addition)
graph = GraphMapper(
    series_2,
    x0=0,
    x1=1,
    y0=4500,
    y1=29331,
    container_name="Bezier",
    cpx=[0, 0.3105086088, 0.5601378679, 1],
    cpy=[0, 0.2931816876, 0.4895456433, 1])
int_7 = Integer(100)
integer_division = IntegerDivision(A=graph, B=int_7)
multiplication = Multiplication(A=integer_division, B=int_7)
shift_2 = ShiftList(List=multiplication, Shift=1, Wrap=False)
subtraction = Subtraction(A=shift_2, B=multiplication)
neg = Negative(Value=multiplication)
X = UnitX(Factor=neg)
cull_i = CullIndex(List=crv_13, Indices=series, Wrap=False)  # -> flatten(List)
move = Move(Geometry=item, Motion=X)  # -> flatten(Geometry), Transform
panel = Panel(subtraction)
merge_5 = Merge(Data1=move.Geometry, Data2=cull_i)

crv_14 = Curve(move.Geometry)
lng_2 = ListLength(List=crv_14)
crv_15 = Curve(crv_12)
crv_16 = Curve(move.Geometry)
crv_17 = Curve(cull_i)
series_3 = Series(Start=0, Step=1, Count=expr("C - 1", Slider(5, range=0..5)))
series_4 = Series(Start=0, Step=1, Count=expr("C - 1", Slider(99, range=0..99)))
item_3 = ListItem(List=crv_14, Index=series_3, Wrap=False)

# ---- group: Plaza Grade
srf_6 = Surface(<surface referenced from the Rhino model>)

# ----
num = Number(305.6)

# ---- group: new sweep (through centerline)
srf_7 = Surface(flatten(offset))

# ----
Z = UnitZ(Factor=-1)
int_8 = Integer(20000)

# ---- group: c_include region
crv_18 = Curve(<curve referenced from the Rhino model>)

# ----
# BEAM SIZE (REF.)
int_9 = Integer(int_2)
int_10 = Integer(int_3)
num_2 = Number(expr("Num * -0.5", int_9))
num_3 = Number(expr("Num * 0.5", int_9))
num_4 = Number(expr("Num * -0.5", int_10))
num_5 = Number(expr("Num * 0.5", int_10))
dom = Domain(DomainStart=num_2, DomainEnd=num_3)
dom_2 = Domain(DomainStart=num_4, DomainEnd=num_5)

domain = Domain(dom)
domain_2 = Domain(dom_2)
domain_3 = Domain(dom)
domain_4 = Domain(dom_2)
num_6 = Number(num_3)
num_7 = Number(num_2)

Z_2 = UnitZ(Factor=int)
panel_2 = Panel(int)
move_2 = Move(Geometry=srf, Motion=Z_2)  # -> Geometry, Transform
move_3 = Move(Geometry=srf_3, Motion=Z_2)  # -> Geometry, Transform
# BASE CURVE REFINEMENT
int_11 = Integer(-250000)
item_4 = ListItem(List=crv_11, Index=Slider(29, range=0..50), Wrap=False)
item_5 = ListItem(List=crv_11, Index=Slider(39, range=0..50), Wrap=False)
item_6 = ListItem(List=crv, Index=4, Wrap=False)
item_7 = ListItem(List=crv, Index=Slider(12, range=0..50), Wrap=False)
item_8 = ListItem(List=crv, Index=Slider(18, range=0..50), Wrap=False)
item_9 = ListItem(List=crv, Index=Slider(23, range=0..50), Wrap=False)
explode = BrepComponents(Brep=move_2.Geometry)  # -> Faces, Edges, Vertices
explode_2 = BrepComponents(Brep=move_3.Geometry)  # -> Faces, Edges, Vertices
Z_3 = UnitZ(Factor=int_11)
item_10 = ListItem(List=explode.Edges, Index=1, Wrap=False)  # -> flatten(Element)
item_11 = ListItem(List=explode_2.Edges, Index=2, Wrap=False)  # -> flatten(Element)
extr = Extrude(Base=item_4, Direction=Z_3)
extr_2 = Extrude(Base=item_5, Direction=Z_3)
extr_3 = Extrude(Base=item_6, Direction=Z_3)
extr_4 = Extrude(Base=item_7, Direction=Z_3)
extr_5 = Extrude(Base=item_8, Direction=Z_3)
extr_6 = Extrude(Base=item_9, Direction=Z_3)
explode_3 = Explode(Curve=crv_2, Recursive=True)  # -> Segments, Vertices
item_12 = ListItem(List=explode_3.Vertices, Index=2, Wrap=False)  # -> flatten(Element)
end_3 = EndPoints(Curve=item_10)  # -> Start, End
bcx = BrepCurve(Brep=extr, Curve=item_10)  # -> Curves, flatten(Points)
bcx_2 = BrepCurve(Brep=extr_2, Curve=item_10)  # -> Curves, flatten(Points)
bcx_3 = BrepCurve(Brep=extr_3, Curve=item_10)  # -> Curves, flatten(Points)
bcx_4 = BrepCurve(Brep=extr_4, Curve=item_10)  # -> Curves, flatten(Points)
bcx_5 = BrepCurve(Brep=extr_5, Curve=item_10)  # -> Curves, flatten(Points); disabled
bcx_6 = BrepCurve(Brep=extr_6, Curve=item_11)  # -> Curves, flatten(Points)
pcomp = Decompose(Point=end_3.End, System=PlaneXY(0, 0, 0))  # -> XComponent, YComponent, ZComponent
pcomp_2 = Decompose(Point=item_12, System=PlaneXY(0, 0, 0))  # -> XComponent, YComponent, ZComponent
crv_cp = CurveCP(Point=bcx_6.Points, Curve=item_11)  # -> Point, Parameter, Distance
pt = PointXYZ(XComponent=pcomp.XComponent, YComponent=pcomp.YComponent, ZComponent=pcomp_2.ZComponent, System=PlaneXY(0, 0, 0))
merge_6 = Merge(Data1=pt, Data2=bcx.Points, Data3=bcx_2.Points, Data4=bcx_3.Points, Data5=bcx_4.Points, Data6=bcx_6.Points)
eval = EvaluateCurve(Curve=item_11, Parameter=crv_cp.Parameter)  # -> Point, Tangent, Angle
intcrv_t = InterpolateT(Vertices=merge_6, Degree=3, TangentStart=Vector(0, 0, 0), TangentEnd=eval.Tangent, KnotStyle=1)  # -> Curve, Length, Domain
line = LineSDL(Start=bcx_6.Points, Direction=eval.Tangent, Length=200000)

eval_2 = EvaluateCurve(Curve=reparameterize(intcrv_t.Curve), Parameter=0)  # -> Point, Tangent, Angle
rev = Reverse(Vector=eval_2.Tangent)
line_2 = LineSDL(Start=eval_2.Point, Direction=rev, Length=10000)

merge_7 = Merge(Data1=line_2, Data2=intcrv_t.Curve, Data3=line)
join = JoinCurves(Curves=merge_7, Preserve=False)

Y = UnitY(Factor=1)
amp = Amplitude(Vector=Y, Amplitude=30000)
move_4 = Move(Geometry=join, Motion=amp)  # -> Geometry, Transform
amp_2 = Amplitude(Vector=Y, Amplitude=-80000)
extr_7 = Extrude(Base=move_4.Geometry, Direction=amp_2)
bbx = BrepBrep(BrepA=extr_7, BrepB=offset)  # -> Curves, Points
item_13 = ListItem(List=bbx.Curves, Index=0, Wrap=False)

# ----
# STEP 2
slider_2 = Slider(1, range=0..1)
dom_3 = Domain(DomainStart=0, DomainEnd=slider_2)
dom_4 = Domain(DomainStart=0, DomainEnd=Slider(1, range=0..1))
crv_19 = Curve(<curve referenced from the Rhino model>)
crv_20 = Curve(item_13)
crv_21 = Curve(reparameterize(<curve referenced from the Rhino model>))
end_4 = EndPoints(Curve=crv_20)  # -> Start, End
flip = Flip(Curve=crv_20)  # -> Curve, Flag
crv_cp_2 = CurveCP(Point=end_4.Start, Curve=crv_21)  # -> Point, Parameter, Distance
subcrv = SubCurve(BaseCurve=reparameterize(flip.Curve), Domain=dom_4)
dom_5 = Domain(DomainStart=crv_cp_2.Parameter, DomainEnd=1)
subcrv_2 = SubCurve(BaseCurve=crv_21, Domain=dom_5)
flip_2 = Flip(Curve=[crv_19, subcrv_2])  # -> Curve, Flag
subcrv_3 = SubCurve(BaseCurve=reparameterize(flip_2.Curve), Domain=dom_3)
preview = CustomPreview(Geometry=subcrv_3, Shader=ColourSwatch(SwatchColor=RGB(255, 255, 255)))
preview_2 = CustomPreview(Geometry=subcrv, Shader=ColourSwatch(SwatchColor=RGB(0, 255, 0)))

# ----
# CHANGE TO CENTERLINE OF WINNING CURVE
planar_2 = Planar(Curve=crv_2)  # -> Planar, Plane, Deviation
offset_2 = Offset(Curve=crv_2, Distance=expr("D * -0.5", int_2), Plane=planar_2.Plane, Corners=1)
num_8 = Number(-0.5)
multiplication_2 = Multiplication(A=int_2, B=num_8)

# ----
# Pt B AND Pt H (TOP OF LINES)
explode_4 = Explode(Curve=flatten(offset_2), Recursive=True)  # -> Segments, Vertices
item_14 = ListItem(List=explode_4.Segments, Index=1, Wrap=False)
item_15 = ListItem(List=explode_4.Vertices, Index=1, Wrap=False)
item_16 = ListItem(List=explode_4.Vertices, Index=2, Wrap=False)
ln = Line(StartPoint=item_15, EndPoint=item_16)
int_12 = Integer(4000)
crv_22 = Curve(crv_3)
ext = Extend(Curve=ln, Type=0, Start=int_12, End=int_12)
offset_3 = Offset(Surface=srf_4, Distance=expr("D * 0.5", int_2), Retrim=True)
swp1 = Sweep1(Rail=crv_22, Sections=item_14, Miter=0)
swp1_2 = Sweep1(Rail=crv_22, Sections=ext, Miter=0)
explode_5 = BrepComponents(Brep=swp1)  # -> Faces, Edges, Vertices
bbx_2 = BrepBrep(BrepA=swp1_2, BrepB=offset_3)  # -> Curves, Points
item_17 = ListItem(List=explode_5.Edges, Index=0, Wrap=False)
item_18 = ListItem(List=explode_5.Edges, Index=2, Wrap=False)
item_19 = ListItem(List=bbx_2.Curves, Index=1, Wrap=False)

item_20 = ListItem(List=explode_4.Segments, Index=0, Wrap=False)
end_5 = EndPoints(Curve=item_20)  # -> Start, End
vec2pt = Vector2Pt(PointA=end_5.Start, PointB=end_5.End, Unitize=False)  # -> Vector, Length
vcomp = Decompose(Vector=vec2pt.Vector)  # -> XComponent, YComponent, ZComponent
vec = VectorXYZ(XComponent=vcomp.XComponent, YComponent=vcomp.YComponent, ZComponent=0)  # -> Vector, Length
angle = Angle(VectorA=vec2pt.Vector, VectorB=vec.Vector)  # -> Angle, Reflex
sin = Sine(Value=angle.Angle)
multiplication_3 = Multiplication(A=multiplication_2, B=sin)

# ---- group: New Curve at base - West
offset_4 = Offset(Curve=crv_9, Distance=multiplication_3, Plane=PlaneXY(0, 0, 0), Corners=1)
project_3 = Project(Geometry=item_13, Plane=planar.Plane)  # -> Geometry, Transform

# ----
merge_8 = Merge(Data1=crv_12, Data2=cull_i, Data3=crv_8, Data4=offset_4, Data5=project_3.Geometry)  # -> flatten(Result)

# ---- group: Pt B - East
project_4 = Project(Geometry=item_17, Plane=planar.Plane)  # -> Geometry, Transform

# ---- group: Pt H - West
project_5 = Project(Geometry=item_19, Plane=planar.Plane)  # -> Geometry, Transform

# ----
item_21 = ListItem(List=merge_8, Index=series_4, Wrap=False)
merge_9 = Merge(Data1=item_21, Data2=item_3, Data3=merge_3)
geo = Geometry(merge_9)
preview_3 = CustomPreview(Geometry=geo, Shader=ColourSwatch(SwatchColor=RGB(255, 255, 255)))

# ---- group: CONSTRUCTION LINES
# SPACING CONSTRUCTION LINES
merge_10 = Merge(Data1=crv_12, Data2=merge_5)
reb = Rebuild(Curve=project_3.Geometry, Count=30, Tangents=False)
crv_23 = Curve(offset_4)
crv_24 = Curve(project_3.Geometry)
ext_2 = Extend(Curve=crv_23, Type=0, Start=30000, End=44000)  # -> reparameterize(Curve)

# ----
end_6 = EndPoints(Curve=crv_23)  # -> Start, End
pt_2 = Point(end_6.Start)
ext_3 = Extend(Curve=reb, Type=2, Start=12500, End=30000)  # -> reparameterize(Curve)

# ----
# EXTEND Pt H CURVE
end_7 = EndPoints(Curve=ext_3)  # -> Start, End
end_8 = EndPoints(Curve=project_5.Geometry)  # -> Start, End
dist_2 = Distance(PointA=end_7.Start, PointB=end_8.Start)
dist_3 = Distance(PointA=end_7.Start, PointB=end_8.End)
larger = LargerThan(FirstNumber=dist_2, SecondNumber=dist_3)  # -> LargerThan, OrEqualTo
flip_3 = Flip(Curve=project_5.Geometry)  # -> Curve, Flag
not = GateNot(A=larger.LargerThan)
merge_11 = Merge(Data1=larger.LargerThan, Data2=not)
merge_12 = Merge(Data1=project_5.Geometry, Data2=flip_3.Curve)
dispatch = Dispatch(List=merge_12, DispatchPattern=merge_11)  # -> ListA, ListB
end_9 = EndPoints(Curve=dispatch.ListB)  # -> Start, End
crv_cp_3 = CurveCP(Point=end_9.Start, Curve=ext_3)  # -> Point, Parameter, Distance
crv_cp_4 = CurveCP(Point=end_9.End, Curve=ext_3)  # -> Point, Parameter, Distance
dom_6 = Domain(DomainStart=0, DomainEnd=crv_cp_3.Parameter)
dom_7 = Domain(DomainStart=crv_cp_4.Parameter, DomainEnd=1)
subcrv_4 = SubCurve(BaseCurve=ext_3, Domain=dom_6)
subcrv_5 = SubCurve(BaseCurve=ext_3, Domain=dom_7)
merge_13 = Merge(Data1=subcrv_4, Data2=project_5.Geometry, Data3=subcrv_5)
connect = ConnectCurves(Curves=merge_13, Continuity=2, Close=False, Bulge=0)

# ---- group: ADDITIONAL POINTS FOR DIAGONAL CONST LINES
crv_25 = Curve(merge_10)
ccx = CurveCurve(CurveA=crv_25, CurveB=ext_3)  # -> flatten(Points), ParamsA, flatten(ParamsB)
ccx_2 = CurveCurve(CurveA=crv_25, CurveB=crv_8)  # -> flatten(Points), ParamsA, flatten(ParamsB)
ccx_3 = CurveCurve(CurveA=crv_25, CurveB=ext_2)  # -> flatten(Points), ParamsA, flatten(ParamsB)
lng_3 = ListLength(List=ccx.ParamsB)
lng_4 = ListLength(List=ccx_3.ParamsB)
C = Count(3)
item_22 = ListItem(List=ccx.ParamsB, Index=expr("i - 1", lng_3), Wrap=False)
item_23 = ListItem(List=ccx_3.ParamsB, Index=expr("i - 1", lng_4), Wrap=False)
eval_3 = EvaluateCurve(Curve=ext_3, Parameter=item_22)  # -> Point, Tangent, Angle
eval_4 = EvaluateCurve(Curve=ext_2, Parameter=item_23)  # -> Point, Tangent, Angle
series_5 = Series(Start=6000, Step=6000, Count=C)
amp_3 = Amplitude(Vector=eval_3.Tangent, Amplitude=series_5)
amp_4 = Amplitude(Vector=eval_4.Tangent, Amplitude=series_5)
rev_2 = Reverse(Vector=amp_3)
rev_3 = Reverse(Vector=amp_4)
move_5 = Move(Geometry=eval_3.Point, Motion=rev_2)  # -> flatten(Geometry), Transform
move_6 = Move(Geometry=eval_4.Point, Motion=rev_3)  # -> flatten(Geometry), Transform
merge_14 = Merge(Data1=ccx.Points, Data2=move_5.Geometry)
merge_15 = Merge(Data1=ccx_3.Points, Data2=move_6.Geometry)
pt_3 = Point(merge_14)
pt_4 = Point(ccx_2.Points)
pt_5 = Point(merge_15)

# ---- group: TRIM START
shift_3 = ShiftList(List=pt_3, Shift=6, Wrap=False)
shift_4 = ShiftList(List=pt_3, Shift=0, Wrap=False)
shift_5 = ShiftList(List=pt_4, Shift=3, Wrap=False)
shift_6 = ShiftList(List=pt_5, Shift=6, Wrap=False)
shift_7 = ShiftList(List=pt_5, Shift=0, Wrap=False)

# ---- group: Extended Pt H Curve - West
reb_2 = Rebuild(Curve=connect, Count=30, Tangents=True)

# ----
cull = CullPattern(List=pt_3, CullPattern=[False, True])
cull_2 = CullPattern(List=shift_5, CullPattern=[False, True])
cull_3 = CullPattern(List=pt_5, CullPattern=[False, True])
plane = PlaneSrf(Plane=cull, XSize=Domain(-2000, 2000), YSize=Domain(-2000, 2000))
plane_2 = PlaneSrf(Plane=cull_2, XSize=Domain(-2000, 2000), YSize=Domain(-2000, 2000))
plane_3 = PlaneSrf(Plane=cull_3, XSize=Domain(-2000, 2000), YSize=Domain(-2000, 2000))
mesh = MeshBrep(
    Brep=plane,
    Settings={Refine=True, JaggedSeams=False, SimplePlanes=True, GridMinCount=16, GridMaxCount=0, Tolerance=0, RefineAngle=0, MinTolerance=0, RelativeTolerance=0.65, MinEdgeLength=0.0001, MaxEdgeLength=0})
mesh_2 = MeshBrep(
    Brep=plane_2,
    Settings={Refine=True, JaggedSeams=False, SimplePlanes=True, GridMinCount=16, GridMaxCount=0, Tolerance=0, RefineAngle=0, MinTolerance=0, RelativeTolerance=0.65, MinEdgeLength=0.0001, MaxEdgeLength=0})
mesh_3 = MeshBrep(
    Brep=plane_3,
    Settings={Refine=True, JaggedSeams=False, SimplePlanes=True, GridMinCount=16, GridMaxCount=0, Tolerance=0, RefineAngle=0, MinTolerance=0, RelativeTolerance=0.65, MinEdgeLength=0.0001, MaxEdgeLength=0})

short = ShortList(ListA=shift_5, ListB=shift_4, TrimMode=2)  # -> ListA, ListB
ln_2 = Line(StartPoint=shift_5, EndPoint=shift_3)
ln_3 = Line(StartPoint=short.ListA, EndPoint=short.ListB)

short_2 = ShortList(ListA=shift_5, ListB=shift_7, TrimMode=2)  # -> ListA, ListB
ln_4 = Line(StartPoint=shift_5, EndPoint=shift_6)
ln_5 = Line(StartPoint=short_2.ListA, EndPoint=short_2.ListB)

int_13 = Integer([1000, 500])
dash_2 = DashPattern(Curve=[ln_2, ln_4, ln_3, ln_5], Pattern=int_13)  # -> Dashes, Gaps

# ----
# DIAGONAL
# CONSTRUCTION LINES & POINTS
cull_4 = CullPattern(List=ln_2, CullPattern=[False, True])
cull_5 = CullPattern(List=ln_3, CullPattern=[False, True])
cull_6 = CullPattern(List=ln_4, CullPattern=[False, True])
cull_7 = CullPattern(List=ln_5, CullPattern=[False, True])
cull_8 = CullPattern(List=shift_5, CullPattern=[False, True])
int_14 = Integer([-3, -2, -1, 0])
shift_8 = ShiftList(List=cull_4, Shift=graft(int_14), Wrap=True)
shift_9 = ShiftList(List=cull_6, Shift=graft(int_14), Wrap=True)
neg_2 = Negative(Value=int_14)
ccx_4 = CurveCurve(CurveA=shift_8, CurveB=cull_5)  # -> simplify(Points), ParamsA, ParamsB
ccx_5 = CurveCurve(CurveA=shift_9, CurveB=cull_7)  # -> simplify(Points), ParamsA, ParamsB
rev_4 = ReverseList(List=neg_2)

plane_4 = PlaneSrf(Plane=ccx_4.Points, XSize=Domain(-2000, 2000), YSize=Domain(-2000, 2000))
plane_5 = PlaneSrf(Plane=ccx_5.Points, XSize=Domain(-2000, 2000), YSize=Domain(-2000, 2000))
mesh_4 = MeshBrep(
    Brep=plane_4,
    Settings={Refine=True, JaggedSeams=False, SimplePlanes=True, GridMinCount=16, GridMaxCount=0, Tolerance=0, RefineAngle=0, MinTolerance=0, RelativeTolerance=0.65, MinEdgeLength=0.0001, MaxEdgeLength=0})
mesh_5 = MeshBrep(
    Brep=plane_5,
    Settings={Refine=True, JaggedSeams=False, SimplePlanes=True, GridMinCount=16, GridMaxCount=0, Tolerance=0, RefineAngle=0, MinTolerance=0, RelativeTolerance=0.65, MinEdgeLength=0.0001, MaxEdgeLength=0})

line_3 = Line(cull_4)
pt_6 = Point(ccx_4.Points)
crv_26 = Curve(reb_2)

int_15 = Integer(3)
line_4 = Line(cull_7)
lng_5 = ListLength(List=int_15)
lng_6 = ListLength(List=cull_4)

line_5 = Line(cull_5)
pshift = ShiftPaths(Data=pt_6, Offset=-1)
shift_10 = ShiftList(List=pshift, Shift=simplify(graft(rev_4)), Wrap=False)  # -> simplify(List)
shift_11 = ShiftList(List=line_5, Shift=int_15, Wrap=False)

viewer = ParamViewer(shift_10)
lng_7 = ListLength(List=viewer)
int_16 = Integer(lng_5)
subtraction_2 = Subtraction(A=lng_7, B=int_16)
series_6 = Series(Start=int_16, Step=1, Count=subtraction_2)
item_24 = ListItem(List=viewer, Index=series_6, Wrap=False)

ext_4 = Extend(Curve=shift_11, Type=0, Start=0, End=2000)
ccx_6 = CurveCurve(CurveA=ext_4, CurveB=crv_26)  # -> simplify(Points), ParamsA, ParamsB
flatten = FlattenTree(Data=ccx_6.Points, Path="{0}")  # -> graft(Data)
branch = TreeBranch(Tree=shift_10, Path=item_24, MaintainPaths=True)  # -> graft(Branch)
merge_16 = Merge(Data1=flatten, Data2=branch)

viewer_2 = ParamViewer(pt_6)
lng_8 = ListLength(List=viewer_2)
int_17 = Integer(lng_6)
subtraction_3 = Subtraction(A=lng_8, B=int_17)
series_7 = Series(Start=int_17, Step=1, Count=subtraction_3)
item_25 = ListItem(List=viewer_2, Index=series_7, Wrap=False)

# ----
# TOP END OF STRAIGHT SEGMENT
# (BEFORE NEW TANGENTS)
# BOTTOM POINTS OF ARC
# (FOR NEW TANGENTS)
ext_5 = Extend(Curve=line_3, Type=0, Start=0, End=2000)
ccx_7 = CurveCurve(CurveA=ext_5, CurveB=crv_26)  # -> simplify(Points), ParamsA, ParamsB
flatten_2 = FlattenTree(Data=ccx_7.Points, Path="{0}")  # -> graft(Data)
branch_2 = TreeBranch(Tree=pt_6, Path=item_25, MaintainPaths=True)
merge_17 = Merge(Data1=flatten_2, Data2=branch_2)

pt_7 = Point(shift_3)
pt_8 = Point(shift_6)

line_6 = Line(cull_6)
crv_27 = Curve(project_4.Geometry)
pt_9 = Point(ccx_5.Points)
pt_10 = Point(cull_8)
pshift_2 = ShiftPaths(Data=pt_9, Offset=-1)

int_18 = Integer(1)
pshift_3 = ShiftPaths(Data=pt_9, Offset=-1)
shift_12 = ShiftList(List=pshift_3, Shift=simplify(graft(rev_4)), Wrap=False)  # -> simplify(List)
shift_13 = ShiftList(List=line_4, Shift=int_15, Wrap=False)
branch_3 = TreeBranch(Tree=shift_12, Path=int_18, MaintainPaths=True)

branch_4 = TreeBranch(Tree=pshift_2, Path=int_18, MaintainPaths=True)

shift_14 = ShiftList(List=pt_10, Shift=int_15, Wrap=False)
ext_6 = Extend(Curve=shift_13, Type=0, Start=0, End=2000)
ccx_8 = CurveCurve(CurveA=ext_6, CurveB=crv_27)  # -> simplify(Points), ParamsA, ParamsB
cluster = Cluster(L=branch_3, A_2=shift_14, B_2=branch_3, L_2=ccx_8.Points, A=shift_14, B=ccx_8.Points)
flatten_3 = FlattenTree(Data=cluster, Path="{0}")  # -> graft(Data)
branch_5 = TreeBranch(Tree=shift_12, Path=item_24, MaintainPaths=True)  # -> graft(Branch)
merge_18 = Merge(Data1=flatten_3, Data2=branch_5)

ext_7 = Extend(Curve=line_6, Type=0, Start=0, End=2000)
ccx_9 = CurveCurve(CurveA=ext_7, CurveB=crv_27)  # -> simplify(Points), ParamsA, ParamsB
cluster_2 = Cluster_2(L=branch_4, L_2=ccx_9.Points, A_2=pt_10, B_2=branch_4, A=pt_10, B=ccx_9.Points)
flatten_4 = FlattenTree(Data=cluster_2, Path="{0}")  # -> graft(Data)
branch_6 = TreeBranch(Tree=pt_9, Path=item_25, MaintainPaths=True)
merge_19 = Merge(Data1=flatten_4, Data2=branch_6)

merge_20 = Merge(Data1=merge_17, Data2=merge_16, Data3=merge_19, Data4=merge_18)
cullpt = CullDuplicates(Points=flatten(merge_20), Tolerance=0.1, CullMode=3)  # -> Points, Indices, Valence

# ----
# INTERSECTION POINTS
# PROJECTED ON SURFACE
pshift_4 = ShiftPaths(Data=merge_17, Offset=-1)
flip_4 = FlipMatrix(Data=pshift_4)
shift_15 = ShiftList(List=flip_4, Shift=1, Wrap=False)  # -> simplify(List)
short_3 = ShortList(ListA=flip_4, ListB=shift_15, TrimMode=2)  # -> ListA, ListB
ln_6 = Line(StartPoint=short_3.ListA, EndPoint=short_3.ListB)
eval_5 = EvaluateCurve(Curve=ln_6, Parameter=0.5)  # -> Point, Tangent, Angle
weave = Weave(Pattern=[0, 1], Stream0=flip_4, Stream1=eval_5.Point, NullGaps=False)
i = Indices(0)

path_mapper = PathMapper(merge_16, source="{A;B}(C)", target="{B}(A)")
shift_16 = ShiftList(List=path_mapper, Shift=1, Wrap=False)  # -> simplify(List)
short_4 = ShortList(ListA=path_mapper, ListB=shift_16, TrimMode=2)  # -> ListA, ListB
ln_7 = Line(StartPoint=short_4.ListA, EndPoint=short_4.ListB)
eval_6 = EvaluateCurve(Curve=ln_7, Parameter=0.5)  # -> Point, Tangent, Angle
weave_2 = Weave(Pattern=[0, 1], Stream0=path_mapper, Stream1=eval_6.Point, NullGaps=False)

# ----
# INTERSECTION POINTS
# PROJECTED ON SURFACE
pshift_5 = ShiftPaths(Data=merge_19, Offset=-1)
flip_5 = FlipMatrix(Data=pshift_5)
shift_17 = ShiftList(List=flip_5, Shift=1, Wrap=False)  # -> simplify(List)
short_5 = ShortList(ListA=flip_5, ListB=shift_17, TrimMode=2)  # -> ListA, ListB
ln_8 = Line(StartPoint=short_5.ListA, EndPoint=short_5.ListB)
eval_7 = EvaluateCurve(Curve=ln_8, Parameter=0.5)  # -> Point, Tangent, Angle
weave_3 = Weave(Pattern=[0, 1], Stream0=flip_5, Stream1=eval_7.Point, NullGaps=False)
i_2 = Indices(0)

path_mapper_2 = PathMapper(merge_18, source="{A;B}(C)", target="{B}(A)")
shift_18 = ShiftList(List=path_mapper_2, Shift=1, Wrap=False)  # -> simplify(List)
short_6 = ShortList(ListA=path_mapper_2, ListB=shift_18, TrimMode=2)  # -> ListA, ListB
ln_9 = Line(StartPoint=short_6.ListA, EndPoint=short_6.ListB)
eval_8 = EvaluateCurve(Curve=ln_9, Parameter=0.5)  # -> Point, Tangent, Angle
weave_4 = Weave(Pattern=[0, 1], Stream0=path_mapper_2, Stream1=eval_8.Point, NullGaps=False)

# ----
# POINTS ON BASE CURVES
planar_3 = Planar(Surface=srf_6, Interior=True)  # -> Planar, Plane
abs = Absolute(Value=int_11)
Z_4 = UnitZ(Factor=num)
panel_3 = Panel(num)
vec_2 = Vector(Z_3)
move_7 = Move(Geometry=planar_3.Plane, Motion=Z_4)  # -> Geometry, Transform
line_7 = LineSDL(Start=pt_7, Direction=vec_2, Length=abs)
line_8 = LineSDL(Start=pt_8, Direction=vec_2, Length=abs)
plx = LinePlane(Line=line_8, Plane=move_7.Geometry)  # -> Point, ParamL, ParamP
brep = Brep(extr_7)
shift_19 = ShiftList(List=plx.Point, Shift=1, Wrap=False)  # -> simplify(List)
bcx_7 = BrepCurve(Brep=brep, Curve=line_7)  # -> Curves, simplify(Points)
cull_9 = CullPattern(List=flatten(bcx_7.Points), CullPattern=[False, True])
pt_11 = Point(simplify(graft(cull_9)))

line_9 = LineSDL(Start=cullpt.Points, Direction=vec_2, Length=abs)
scx = SurfaceCurve(Surface=srf_7, Curve=line_9)  # -> Curves, simplify(Points), UVPoints, Normals, Parameters, Tangents
msphere = MeshSphere(Base=scx.Points, Radius=2000, UCount=6, VCount=12)
msphere_2 = MeshSphere(Base=scx.Points, Radius=1200, UCount=6, VCount=12)
line_10 = LineSDL(Start=scx.Points, Direction=Z, Length=int_8)

line_11 = LineSDL(Start=weave, Direction=vec_2, Length=abs)
scx_2 = SurfaceCurve(Surface=srf_7, Curve=line_11)  # -> Curves, simplify(Points), UVPoints, Normals, Parameters, Tangents
viewer_3 = ParamViewer(scx_2.Points)
cluster_3 = Cluster_3(T=scx_2.Points, T_2=scx_2.Points, i=i, L=viewer_3, I=scx_2.Points)
cull_10 = CullPattern(List=cluster_3, CullPattern=[True, False, True, False, True, False, False])
cull_11 = CullPattern(List=cluster_3, CullPattern=[False, True, False, True, False, True, False])
cull_12 = CullPattern(List=cluster_3, CullPattern=[False, False, True, False, True, False, True])
arc = Arc3Pt(PointA=cull_10, PointB=cull_11, PointC=cull_12)  # -> Arc, Plane, Radius

line_12 = LineSDL(Start=weave_2, Direction=vec_2, Length=abs)
scx_3 = SurfaceCurve(Surface=srf_7, Curve=line_12)  # -> Curves, simplify(Points), UVPoints, Normals, Parameters, Tangents
pshift_6 = ShiftPaths(Data=scx_3.Points, Offset=-1)
cull_13 = CullPattern(List=pshift_6, CullPattern=[True, False, True, False, True, False, False])
cull_14 = CullPattern(List=pshift_6, CullPattern=[False, True, False, True, False, True, False])
cull_15 = CullPattern(List=pshift_6, CullPattern=[False, False, True, False, True, False, True])
arc_2 = Arc3Pt(PointA=cull_13, PointB=cull_14, PointC=cull_15)  # -> Arc, Plane, Radius

line_13 = LineSDL(Start=weave_4, Direction=vec_2, Length=abs)
scx_4 = SurfaceCurve(Surface=srf_7, Curve=line_13)  # -> Curves, simplify(Points), UVPoints, Normals, Parameters, Tangents
pshift_7 = ShiftPaths(Data=scx_4.Points, Offset=-1)
cull_16 = CullPattern(List=pshift_7, CullPattern=[True, False, True, False, True, False, False])
cull_17 = CullPattern(List=pshift_7, CullPattern=[False, True, False, True, False, True, False])
cull_18 = CullPattern(List=pshift_7, CullPattern=[False, False, True, False, True, False, True])
arc_3 = Arc3Pt(PointA=cull_16, PointB=cull_17, PointC=cull_18)  # -> Arc, Plane, Radius

line_14 = LineSDL(Start=weave_3, Direction=vec_2, Length=abs)
scx_5 = SurfaceCurve(Surface=srf_7, Curve=line_14)  # -> Curves, simplify(Points), UVPoints, Normals, Parameters, Tangents
viewer_4 = ParamViewer(scx_5.Points)
cluster_4 = Cluster_3(T=scx_5.Points, T_2=scx_5.Points, i=i_2, L=viewer_4, I=scx_5.Points)
cull_19 = CullPattern(List=cluster_4, CullPattern=[True, False, True, False, True, False, False])
cull_20 = CullPattern(List=cluster_4, CullPattern=[False, True, False, True, False, True, False])
cull_21 = CullPattern(List=cluster_4, CullPattern=[False, False, True, False, True, False, True])
arc_4 = Arc3Pt(PointA=cull_19, PointB=cull_20, PointC=cull_21)  # -> Arc, Plane, Radius

plx_2 = LinePlane(Line=line_10, Plane=move_7.Geometry)  # -> Point, ParamL, ParamP
ln_10 = Line(StartPoint=scx.Points, EndPoint=plx_2.Point)
cull_22 = CullPattern(List=shift_19, CullPattern=[True, False])

pt_12 = Point(simplify(graft(cull_22)))

cullpt_2 = CullDuplicates(Points=flatten([pt_11, pt_12]), Tolerance=0.1, CullMode=3)  # -> Points, Indices, Valence
msphere_3 = MeshSphere(Base=cullpt_2.Points, Radius=2000, UCount=6, VCount=12)

# ----
# POINTS AND ARCS
# FOR NEW TANGENT LINES
# NEW TANGENT LINES
# & ARCS (BEFORE RATIONALIZATION)
item_26 = ListItem(List=arc.Arc, Index=2, Wrap=False)
item_27 = ListItem(List=arc.Arc, Index=1, Wrap=False)
item_28 = ListItem(List=arc.Arc, Index=0, Wrap=False)
item_29 = ListItem(List=arc_2.Arc, Index=2, Wrap=False)
item_30 = ListItem(List=arc_2.Arc, Index=1, Wrap=False)
item_31 = ListItem(List=arc_2.Arc, Index=0, Wrap=False)
item_32 = ListItem(List=arc_4.Arc, Index=2, Wrap=False)
item_33 = ListItem(List=arc_4.Arc, Index=1, Wrap=False)
item_34 = ListItem(List=arc_4.Arc, Index=0, Wrap=False)
item_35 = ListItem(List=arc_3.Arc, Index=2, Wrap=False)
item_36 = ListItem(List=arc_3.Arc, Index=1, Wrap=False)
item_37 = ListItem(List=arc_3.Arc, Index=0, Wrap=False)
pi = Pi(Factor=1)
path_mapper_3 = PathMapper(item_26, source="{A}", target="{3;A}")
path_mapper_4 = PathMapper(item_27, source="{A}", target="{2;A}")
path_mapper_5 = PathMapper(item_29, source="{A}", target="{3;A}")
path_mapper_6 = PathMapper(item_30, source="{A}", target="{2;A}")
path_mapper_7 = PathMapper(item_32, source="{A}", target="{3;A}")
path_mapper_8 = PathMapper(item_35, source="{A}", target="{3;A}")

len = Length(Curve=item_34)
int_19 = Integer(100)
smaller = SmallerThan(FirstNumber=len, SecondNumber=int_19)  # -> SmallerThan, OrEqualTo
viewer_5 = ParamViewer(item_34)
dispatch_2 = Dispatch(List=viewer_5, DispatchPattern=flatten(smaller.SmallerThan))  # -> ListA, ListB
branch_7 = TreeBranch(Tree=item_33, Path=dispatch_2.ListB, MaintainPaths=True)
branch_8 = TreeBranch(Tree=item_33, Path=dispatch_2.ListA, MaintainPaths=True)
branch_9 = TreeBranch(Tree=item_34, Path=dispatch_2.ListB, MaintainPaths=True)
merge_21 = Merge(Data1=branch_8, Data2=branch_9)
pframe = PerpFrame(Curve=reparameterize(merge_21), Parameter=1)
tan = TangentLines(Point=pt_12, Circle=merge_21)  # -> Tangent1, Tangent2
pcomp_3 = PlaneComponents(Plane=pframe)  # -> Origin, XAxis, YAxis, ZAxis

len_2 = Length(Curve=item_37)
int_20 = Integer(100)
smaller_2 = SmallerThan(FirstNumber=len_2, SecondNumber=int_20)  # -> SmallerThan, OrEqualTo
viewer_6 = ParamViewer(item_37)
dispatch_3 = Dispatch(List=viewer_6, DispatchPattern=flatten(smaller_2.SmallerThan))  # -> ListA, ListB
branch_10 = TreeBranch(Tree=item_36, Path=dispatch_3.ListB, MaintainPaths=True)
branch_11 = TreeBranch(Tree=item_36, Path=dispatch_3.ListA, MaintainPaths=True)
branch_12 = TreeBranch(Tree=item_37, Path=dispatch_3.ListB, MaintainPaths=True)
merge_22 = Merge(Data1=branch_11, Data2=branch_12)
viewer_7 = ParamViewer(merge_22)
branch_13 = TreeBranch(Tree=pt_12, Path=viewer_7, MaintainPaths=True)
pframe_2 = PerpFrame(Curve=reparameterize(merge_22), Parameter=1)
tan_2 = TangentLines(Point=branch_13, Circle=merge_22)  # -> Tangent1, Tangent2
pcomp_4 = PlaneComponents(Plane=pframe_2)  # -> Origin, XAxis, YAxis, ZAxis

viewer_8 = ParamViewer(item_31)
branch_14 = TreeBranch(Tree=pt_11, Path=viewer_8, MaintainPaths=True)
pframe_3 = PerpFrame(Curve=reparameterize(item_31), Parameter=1)
tan_3 = TangentLines(Point=branch_14, Circle=item_31)  # -> Tangent1, Tangent2
pcomp_5 = PlaneComponents(Plane=pframe_3)  # -> Origin, XAxis, YAxis, ZAxis

pframe_4 = PerpFrame(Curve=reparameterize(item_28), Parameter=1)
tan_4 = TangentLines(Point=pt_11, Circle=item_28)  # -> Tangent1, Tangent2
pcomp_6 = PlaneComponents(Plane=pframe_4)  # -> Origin, XAxis, YAxis, ZAxis

xprod = CrossProduct(VectorA=tan_4.Tangent1, VectorB=pcomp_6.YAxis, Unitize=False)  # -> Vector, Length
ext_8 = Extend(Curve=item_28, Type=0, Start=3000, End=0)
end_10 = EndPoints(Curve=tan_4.Tangent1)  # -> Start, End
null = NullItem(Item=tan_4.Tangent1)  # -> NullFlags, InvalidFlags, Description
pt_13 = Point(pt_11)
dispatch_4 = Dispatch(List=pt_13, DispatchPattern=null.NullFlags)  # -> ListA, ListB
dispatch_5 = Dispatch(List=item_28, DispatchPattern=null.NullFlags)  # -> ListA, ListB
crv_cp_5 = CurveCP(Point=end_10.End, Curve=reparameterize(ext_8))  # -> Point, Parameter, Distance
pl = Plane(Origin=end_10.Start, XAxis=xprod.Vector, YAxis=pcomp_6.YAxis)
dom_8 = Domain(DomainStart=crv_cp_5.Parameter, DomainEnd=1)
subcrv_6 = SubCurve(BaseCurve=reparameterize(ext_8), Domain=dom_8)
end_11 = EndPoints(Curve=dispatch_5.ListA)  # -> Start, End
eval_9 = EvaluateCurve(Curve=reparameterize(dispatch_5.ListA), Parameter=0.5)  # -> Point, Tangent, Angle
end_12 = EndPoints(Curve=subcrv_6)  # -> Start, End
eval_10 = EvaluateCurve(Curve=reparameterize(subcrv_6), Parameter=0.5)  # -> Point, Tangent, Angle
arc_5 = Arc3Pt(PointA=dispatch_4.ListA, PointB=eval_9.Point, PointC=end_11.End)  # -> Arc, Plane, Radius
arc_6 = Arc3Pt(PointA=end_10.End, PointB=eval_10.Point, PointC=end_12.End)  # -> Arc, Plane, Radius
clean = CleanTree(Data=arc_6.Arc, CleanInvalid=True, CleanEmpty=False)
prot = RotatePlane(Plane=pl, Angle=pi)
line_15 = Line(tan_4.Tangent1)

xprod_2 = CrossProduct(VectorA=tan_3.Tangent1, VectorB=pcomp_5.YAxis, Unitize=False)  # -> Vector, Length
ext_9 = Extend(Curve=item_31, Type=0, Start=3000, End=0)
end_13 = EndPoints(Curve=tan_3.Tangent1)  # -> Start, End
null_2 = NullItem(Item=tan_3.Tangent1)  # -> NullFlags, InvalidFlags, Description
pt_14 = Point(branch_14)
pl_2 = Plane(Origin=end_13.Start, XAxis=xprod_2.Vector, YAxis=pcomp_5.YAxis)
dispatch_6 = Dispatch(List=pt_14, DispatchPattern=null_2.NullFlags)  # -> ListA, ListB
dispatch_7 = Dispatch(List=item_31, DispatchPattern=null_2.NullFlags)  # -> ListA, ListB
crv_cp_6 = CurveCP(Point=end_13.End, Curve=reparameterize(ext_9))  # -> Point, Parameter, Distance
dom_9 = Domain(DomainStart=crv_cp_6.Parameter, DomainEnd=1)
subcrv_7 = SubCurve(BaseCurve=reparameterize(ext_9), Domain=dom_9)
end_14 = EndPoints(Curve=dispatch_7.ListA)  # -> Start, End
eval_11 = EvaluateCurve(Curve=reparameterize(dispatch_7.ListA), Parameter=0.5)  # -> Point, Tangent, Angle
end_15 = EndPoints(Curve=subcrv_7)  # -> Start, End
eval_12 = EvaluateCurve(Curve=reparameterize(subcrv_7), Parameter=0.5)  # -> Point, Tangent, Angle
arc_7 = Arc3Pt(PointA=dispatch_6.ListA, PointB=eval_11.Point, PointC=end_14.End)  # -> Arc, Plane, Radius
arc_8 = Arc3Pt(PointA=end_13.End, PointB=eval_12.Point, PointC=end_15.End)  # -> Arc, Plane, Radius
clean_2 = CleanTree(Data=arc_8.Arc, CleanInvalid=True, CleanEmpty=False)
prot_2 = RotatePlane(Plane=pl_2, Angle=pi)
line_16 = Line(tan_3.Tangent1)

xprod_3 = CrossProduct(VectorA=tan.Tangent1, VectorB=pcomp_3.YAxis, Unitize=False)  # -> Vector, Length
ext_10 = Extend(Curve=merge_21, Type=0, Start=3000, End=0)
end_16 = EndPoints(Curve=tan.Tangent1)  # -> Start, End
crv_cp_7 = CurveCP(Point=end_16.End, Curve=reparameterize(ext_10))  # -> Point, Parameter, Distance
pl_3 = Plane(Origin=end_16.Start, XAxis=xprod_3.Vector, YAxis=pcomp_3.YAxis)
dom_10 = Domain(DomainStart=crv_cp_7.Parameter, DomainEnd=1)
subcrv_8 = SubCurve(BaseCurve=reparameterize(ext_10), Domain=dom_10)
end_17 = EndPoints(Curve=subcrv_8)  # -> Start, End
eval_13 = EvaluateCurve(Curve=reparameterize(subcrv_8), Parameter=0.5)  # -> Point, Tangent, Angle
arc_9 = Arc3Pt(PointA=end_16.End, PointB=eval_13.Point, PointC=end_17.End)  # -> Arc, Plane, Radius
clean_3 = CleanTree(Data=arc_9.Arc, CleanInvalid=True, CleanEmpty=False)
prot_3 = RotatePlane(Plane=pl_3, Angle=pi)
branch_15 = TreeBranch(Tree=clean_3, Path=dispatch_2.ListA, MaintainPaths=True)
branch_16 = TreeBranch(Tree=clean_3, Path=dispatch_2.ListB, MaintainPaths=True)
line_17 = Line(tan.Tangent1)

xprod_4 = CrossProduct(VectorA=tan_2.Tangent1, VectorB=pcomp_4.YAxis, Unitize=False)  # -> Vector, Length
ext_11 = Extend(Curve=merge_22, Type=0, Start=3000, End=0)
end_18 = EndPoints(Curve=tan_2.Tangent1)  # -> Start, End
crv_cp_8 = CurveCP(Point=end_18.End, Curve=reparameterize(ext_11))  # -> Point, Parameter, Distance
pl_4 = Plane(Origin=end_18.Start, XAxis=xprod_4.Vector, YAxis=pcomp_4.YAxis)
dom_11 = Domain(DomainStart=crv_cp_8.Parameter, DomainEnd=1)
subcrv_9 = SubCurve(BaseCurve=reparameterize(ext_11), Domain=dom_11)
end_19 = EndPoints(Curve=subcrv_9)  # -> Start, End
eval_14 = EvaluateCurve(Curve=reparameterize(subcrv_9), Parameter=0.5)  # -> Point, Tangent, Angle
arc_10 = Arc3Pt(PointA=end_18.End, PointB=eval_14.Point, PointC=end_19.End)  # -> Arc, Plane, Radius
clean_4 = CleanTree(Data=arc_10.Arc, CleanInvalid=True, CleanEmpty=False)
prot_4 = RotatePlane(Plane=pl_4, Angle=pi)
line_18 = Line(tan_2.Tangent1)

branch_17 = TreeBranch(Tree=clean_4, Path=dispatch_3.ListA, MaintainPaths=True)
branch_18 = TreeBranch(Tree=clean_4, Path=dispatch_3.ListB, MaintainPaths=True)

merge_23 = Merge(Data1=arc_5.Arc, Data2=clean)
merge_24 = Merge(Data1=arc_7.Arc, Data2=clean_2)
merge_25 = Merge(Data1=branch_7, Data2=branch_15)
merge_26 = Merge(Data1=branch_10, Data2=branch_17)
path_mapper_9 = PathMapper(merge_23, source="{A}", target="{1;A}")
path_mapper_10 = PathMapper(merge_24, source="{A}", target="{1;A}")
path_mapper_11 = PathMapper(merge_25, source="{A}", target="{2;A}")
path_mapper_12 = PathMapper(branch_16, source="{A}", target="{1;A}")
path_mapper_13 = PathMapper(merge_26, source="{A}", target="{2;A}")
path_mapper_14 = PathMapper(branch_18, source="{A}", target="{1;A}")
merge_27 = Merge(Data1=path_mapper_3, Data2=path_mapper_4, Data3=path_mapper_9)
merge_28 = Merge(Data1=path_mapper_5, Data2=path_mapper_6, Data3=path_mapper_10)
merge_29 = Merge(Data1=path_mapper_7, Data2=path_mapper_11, Data3=path_mapper_12)
merge_30 = Merge(Data1=path_mapper_8, Data2=path_mapper_13, Data3=path_mapper_14)

# ----
# ARCS, LINES & PLANES
# FOR RATIONALIZATION AND SOLIDS
path_mapper_15 = PathMapper(line_15, source="{A}", target="{3;A}")
path_mapper_16 = PathMapper(line_16, source="{A}", target="{2;A}")
path_mapper_17 = PathMapper(line_17, source="{A}", target="{1;A}")
path_mapper_18 = PathMapper(line_18, source="{A}", target="{0;A}")
path_mapper_19 = PathMapper(prot, source="{A}", target="{3;A}")
path_mapper_20 = PathMapper(prot_2, source="{A}", target="{2;A}")
path_mapper_21 = PathMapper(prot_3, source="{A}", target="{1;A}")
path_mapper_22 = PathMapper(prot_4, source="{A}", target="{0;A}")
path_mapper_23 = PathMapper(merge_27, source="{A;B}", target="{3;A;B}")
path_mapper_24 = PathMapper(merge_28, source="{A;B}", target="{2;A;B}")
path_mapper_25 = PathMapper(merge_29, source="{A;B}", target="{1;A;B}")
path_mapper_26 = PathMapper(merge_30, source="{A;B}", target="{0;A;B}")
merge_31 = Merge(Data1=path_mapper_15, Data2=path_mapper_16, Data3=path_mapper_17, Data4=path_mapper_18)
merge_32 = Merge(Data1=path_mapper_19, Data2=path_mapper_20, Data3=path_mapper_21, Data4=path_mapper_22)
merge_33 = Merge(Data1=path_mapper_23, Data2=path_mapper_24, Data3=path_mapper_25, Data4=path_mapper_26)
path_mapper_27 = PathMapper(merge_31, source="{A;B}", target="{A;0;B}")
path_mapper_28 = PathMapper(merge_32, source="{A;B}", target="{A;0;B}")

# ----
# EXTENT OF STRUCTURE IN PLAN
eval_15 = EvaluateCurve(Curve=reparameterize(path_mapper_27), Parameter=0.5)  # -> Point, Tangent, Angle
eval_16 = EvaluateCurve(Curve=reparameterize(merge_33), Parameter=0.5)  # -> Point, Tangent, Angle
project_6 = Project(Geometry=crv_18, Plane=planar.Plane)  # -> Geometry, Transform
con = Containment(Point=eval_15.Point, Curve=project_6.Geometry)  # -> Relationship, Point
con_2 = Containment(Point=eval_16.Point, Curve=project_6.Geometry)  # -> Relationship, Point
equals = Equality(FirstNumber=con.Relationship, SecondNumber=0)  # -> Equality, Inequality
equals_2 = Equality(FirstNumber=con_2.Relationship, SecondNumber=0)  # -> Equality, Inequality
cull_23 = CullPattern(List=path_mapper_27, CullPattern=equals.Inequality)
cull_24 = CullPattern(List=path_mapper_28, CullPattern=equals.Inequality)
cull_25 = CullPattern(List=merge_33, CullPattern=equals_2.Inequality)

int_21 = Integer([1000, 500])
dash_3 = DashPattern(Curve=cull_25, Pattern=int_21)  # -> Dashes, Gaps

line_19 = Line(cull_23)

# ----
# ARCS (RATIONALIZED RADII)
end_20 = EndPoints(Curve=cull_25)  # -> Start, End
planar_4 = Planar(Curve=cull_25)  # -> Planar, Plane, Deviation
cen = Center(Arc=cull_25)  # -> Center, Radius
int_22 = Integer(2500)
integer_division_2 = IntegerDivision(A=cen.Radius, B=int_22)
panel_4 = Panel(int_22)
multiplication_4 = Multiplication(A=integer_division_2, B=int_22)
vb = VBScript(p1=end_20.Start, p2=end_20.End, plane=planar_4.Plane, r=multiplication_4, toggle=Toggle(True))  # -> out, A; inputs p1: Point3d, p2: Point3d, plane: Vector3d
# ---------- vb: VB ----------
    'find the midpoint
    Dim midPt As New Point3D(((p1.X + p2.X) / 2), ((p1.Y + p2.Y) / 2), ((p1.Z + p2.Z) / 2))

    'perpendicular vector
    Dim vec As New Vector3d((p1.X - p2.X), (p1.Y - p2.Y), (p1.Z - p2.Z))
    vec.Rotate(math.PI / 2, plane)

    'find y and x
    Dim y As Double = vec.Length / 2
    Dim x As Double

    If toggle = True Then
      x = r - math.Sqrt(r ^ 2 - y ^ 2)
    Else If toggle = False Then
      x = -(r - math.Sqrt(r ^ 2 - y ^ 2))
    End If

    'move the midpoint for arc center
    Dim lineC As New Line(midPt, vec, x)
    Dim arcmidPt As New Point3D(lineC.To)

    'draw the arc from 3 points
    Dim arc3pt As New Arc(p1, arcmidPt, p2)

    A = arc3pt
# ---------- end vb ----------
len_3 = Length(Curve=vb.A)
int_23 = Integer(1)
larger_2 = LargerThan(FirstNumber=len_3, SecondNumber=int_23)  # -> LargerThan, OrEqualTo
cull_26 = CullPattern(List=vb.A, CullPattern=larger_2.LargerThan)

# ----
# LINES
# ON-SCREEN: SLOPE AT BASE
item_38 = ListItem(List=line_19, Index=0, Wrap=False)
eval_17 = EvaluateCurve(Curve=reparameterize(item_38), Parameter=1)  # -> Point, Tangent, Angle
vec_3 = Vector(eval_17.Tangent)
rev_5 = Reverse(Vector=vec_3)
vcomp_2 = Decompose(Vector=rev_5)  # -> XComponent, YComponent, ZComponent
vec_4 = VectorXYZ(XComponent=vcomp_2.XComponent, YComponent=vcomp_2.YComponent, ZComponent=0)  # -> Vector, Length
angle_2 = Angle(VectorA=vec_4.Vector, VectorB=rev_5)  # -> Angle, Reflex
deg = Degrees(Radians=angle_2.Angle)
pshift_8 = ShiftPaths(Data=deg, Offset=-2)
graph_2 = QuickGraph(pshift_8)

line_20 = Line(line_19)
vec_5 = Vector(line_20)
vcomp_3 = Decompose(Vector=vec_5)  # -> XComponent, YComponent, ZComponent
vec_6 = VectorXYZ(XComponent=vcomp_3.XComponent, YComponent=vcomp_3.YComponent, ZComponent=0)  # -> Vector, Length
int_24 = Integer(1500)
angle_3 = Angle(VectorA=vec_6.Vector, VectorB=vec_5)  # -> Angle, Reflex
amp_5 = Amplitude(Vector=vec_5, Amplitude=int_24)
amp_6 = Amplitude(Vector=vec_6.Vector, Amplitude=int_24)
end_21 = EndPoints(Curve=line_20)  # -> Start, End
deg_2 = Degrees(Radians=angle_3.Angle)
addition_2 = Addition(A=amp_5, B=amp_6)
amp_7 = Amplitude(Vector=addition_2, Amplitude=int_24)
move_8 = Move(Geometry=end_21.Start, Motion=amp_5)  # -> Geometry, Transform
move_9 = Move(Geometry=end_21.Start, Motion=amp_7)  # -> Geometry, Transform
move_10 = Move(Geometry=end_21.Start, Motion=amp_6)  # -> Geometry, Transform
pshift_9 = ShiftPaths(Data=deg_2, Offset=-2)
arc_11 = Arc3Pt(PointA=move_8.Geometry, PointB=move_9.Geometry, PointC=move_10.Geometry)  # -> Arc, Plane, Radius
vdisex = VectorDisplayEx(Point=end_21.Start, Vector=amp_5, Colour=RGB(0, 0, 0), Width=2)
vdisex_2 = VectorDisplayEx(Point=end_21.Start, Vector=amp_6, Colour=RGB(0, 0, 0), Width=2)
graph_3 = QuickGraph(pshift_9)

# ----
# ARCS
arc_12 = CircularArc(cull_25)
pshift_10 = ShiftPaths(Data=arc_12, Offset=-1)
cen_2 = Center(Arc=pshift_10)  # -> Center, Radius
int_25 = Integer(int_22)
integer_division_3 = IntegerDivision(A=cen_2.Radius, B=int_25)
cset = CreateSet(List=flatten(integer_division_3))  # -> Set, Map
multiplication_5 = Multiplication(A=integer_division_3, B=int_25)
lng_9 = ListLength(List=flatten(multiplication_5))
lng_10 = ListLength(List=cset.Set)
panel_5 = Panel(lng_10)
panel_6 = Panel(lng_9)

graph_4 = QuickGraph(cen_2.Radius)
graph_5 = QuickGraph(multiplication_5)

# ----
# LINES + ARCS
merge_34 = Merge(Data1=cull_23, Data2=vb.A)
path_mapper_29 = PathMapper(merge_34, source="{A;B;C}", target="{A;C}")
crv_28 = Curve(path_mapper_29)

join_2 = JoinCurves(Curves=crv_28, Preserve=False)  # -> simplify(Curves)
pln = Plane(cull_24)
arc_13 = CircularArc(cull_26)
line_21 = Line(cull_23)
int_26 = Integer(multiplication_4)
arc_14 = CircularArc(cull_26)
pln_2 = Plane(planar_4.Plane)
int_27 = Integer(multiplication_4)

# ----
# LINES
rectangle = Rectangle(Plane=pln, XSize=domain, YSize=domain_2, Radius=0)  # -> Rectangle, Length
swp1_3 = Sweep1(Rail=line_21, Sections=rectangle.Rectangle, Miter=1)
cap = CapHoles(Brep=swp1_3)
mesh_6 = MeshBrep(
    Brep=cap,
    Settings={Refine=True, JaggedSeams=False, SimplePlanes=True, GridMinCount=16, GridMaxCount=0, Tolerance=0, RefineAngle=0, MinTolerance=0, RelativeTolerance=0.65, MinEdgeLength=0.0001, MaxEdgeLength=0})
preview_4 = CustomPreview(Geometry=mesh_6, Shader=ColourSwatch(SwatchColor=RGB(11, 189, 29)))

# ----
# POINTS
end_22 = EndPoints(Curve=crv_28)  # -> Start, End
pt_15 = Point(flatten([end_22.Start, end_22.End]))
cullpt_3 = CullDuplicates(Points=pt_15, Tolerance=0.1, CullMode=3)  # -> Points, Indices, Valence

reb_3 = Rebuild(Curve=join_2, Count=10, Tangents=False)
# ARCS
eval_18 = EvaluateCurve(Curve=reb_3, Parameter=0)  # -> Point, Tangent, Angle
Z_5 = UnitZ(Factor=1)
xprod_5 = CrossProduct(VectorA=unitize(eval_18.Tangent), VectorB=Z_5, Unitize=True)  # -> Vector, Length
xprod_6 = CrossProduct(VectorA=xprod_5.Vector, VectorB=unitize(eval_18.Tangent), Unitize=False)  # -> Vector, Length
pl_5 = Plane(Origin=eval_18.Point, XAxis=xprod_5.Vector, YAxis=xprod_6.Vector)
rectangle_2 = Rectangle(Plane=pl_5, XSize=domain_2, YSize=domain, Radius=0)  # -> graft(Rectangle), Length
swp1_4 = Sweep1(Rail=graft(reb_3), Sections=rectangle_2.Rectangle, Miter=1)
cap_2 = CapHoles(Brep=swp1_4)

int_28 = Integer(int_26)
bnd = Bounds(Numbers=flatten(int_28))
int_29 = Integer(30001)
int_30 = Integer(50001)
domcomp = DomainComponents(Domain=bnd)  # -> Start, End
pframe_5 = PerpFrame(Curve=reparameterize(arc_13), Parameter=0)
rectangle_3 = Rectangle(Plane=pframe_5, XSize=domain_3, YSize=domain_4, Radius=0)  # -> Rectangle, Length
dom_12 = Domain(DomainStart=domcomp.Start, DomainEnd=int_29)
dom_13 = Domain(DomainStart=int_29, DomainEnd=int_30)
dom_14 = Domain(DomainStart=int_30, DomainEnd=domcomp.End)
swp1_5 = Sweep1(Rail=graft(arc_13), Sections=graft(rectangle_3.Rectangle), Miter=1)  # -> simplify(Brep)
gradient = Gradient(LowerLimit=domcomp.Start, UpperLimit=domcomp.End, Parameter=int_28, stops=[0: RGB(255, 0, 0), 0.989: RGB(0, 0, 255)])
inc = Includes(Value=int_28, Domain=dom_12)  # -> graft(Includes), Deviation
inc_2 = Includes(Value=int_28, Domain=dom_13)  # -> graft(Includes), Deviation
inc_3 = Includes(Value=int_28, Domain=dom_14)  # -> graft(Includes), Deviation
swatch = ColourSwatch(SwatchColor=RGB(230, 190, 0))
swatch_2 = ColourSwatch(SwatchColor=RGB(255, 0, 0))
swatch_3 = ColourSwatch(SwatchColor=RGB(0, 0, 255))
cull_27 = CullPattern(List=swp1_5, CullPattern=inc.Includes)
cull_28 = CullPattern(List=swp1_5, CullPattern=inc_2.Includes)
cull_29 = CullPattern(List=swp1_5, CullPattern=inc_3.Includes)
pshift_11 = ShiftPaths(Data=swp1_5, Offset=-1)
mesh_7 = MeshBrep(
    Brep=cull_28,
    Settings={Refine=True, JaggedSeams=False, SimplePlanes=True, GridMinCount=16, GridMaxCount=0, Tolerance=0, RefineAngle=0, MinTolerance=0, RelativeTolerance=0.65, MinEdgeLength=0.0001, MaxEdgeLength=0})
mesh_8 = MeshBrep(
    Brep=cull_27,
    Settings={Refine=True, JaggedSeams=False, SimplePlanes=True, GridMinCount=16, GridMaxCount=0, Tolerance=0, RefineAngle=0, MinTolerance=0, RelativeTolerance=0.65, MinEdgeLength=0.0001, MaxEdgeLength=0})
mesh_9 = MeshBrep(
    Brep=cull_29,
    Settings={Refine=True, JaggedSeams=False, SimplePlanes=True, GridMinCount=16, GridMaxCount=0, Tolerance=0, RefineAngle=0, MinTolerance=0, RelativeTolerance=0.65, MinEdgeLength=0.0001, MaxEdgeLength=0})
preview_5 = CustomPreview(Geometry=pshift_11, Shader=gradient)
preview_6 = CustomPreview(Geometry=mesh_8, Shader=swatch)
preview_7 = CustomPreview(Geometry=mesh_7, Shader=swatch_2)
preview_8 = CustomPreview(Geometry=mesh_9, Shader=swatch_3)

# ----
# ON-SCREEN: RADII, QTY
# & PROFILES
pshift_12 = ShiftPaths(Data=arc_14, Offset=-1)
planar_5 = Planar(Curve=pshift_12)  # -> Planar, Plane, Deviation
xy = XYPlane(Origin=Point(0, 0, 0))
orient = Orient(Geometry=pshift_12, Source=planar_5.Plane, Target=xy)  # -> graft(Geometry), Transform
offset_5 = Offset(Curve=orient.Geometry, Distance=num_6, Plane=PlaneXY(0, 0, 0), Corners=1)  # -> simplify(Curve)
offset_6 = Offset(Curve=orient.Geometry, Distance=num_7, Plane=PlaneXY(0, 0, 0), Corners=1)  # -> simplify(Curve)
end_23 = EndPoints(Curve=offset_5)  # -> Start, End
end_24 = EndPoints(Curve=offset_6)  # -> Start, End
cen_3 = Center(Arc=orient.Geometry)  # -> Center, Radius
viewer_9 = ParamViewer(orient.Geometry)
ln_11 = Line(StartPoint=end_23.Start, EndPoint=end_24.Start)
ln_12 = Line(StartPoint=end_23.End, EndPoint=end_24.End)
int_31 = Integer(flatten(cen_3.Radius))
merge_35 = Merge(Data1=offset_5, Data2=ln_11, Data3=ln_12, Data4=offset_6)
replace = ReplaceBranches(Data=end_23.Start, Search=viewer_9, Replace=int_31)
replace_2 = ReplaceBranches(Data=orient.Geometry, Search=viewer_9, Replace=int_31)
join_3 = JoinCurves(Curves=merge_35, Preserve=False)
tstat = TreeStatistics(Tree=replace_2)  # -> Paths, Length, Count
lng_11 = ListLength(List=replace_2)  # -> flatten(Length)
dpath = DecomposePath(Branch=tstat.Paths)  # -> simplify(Indices)
int_32 = Integer(simplify(graft(lng_11)))
item_39 = ListItem(List=replace, Index=0, Wrap=False)  # -> flatten(Element)
expression = Expression(x=dpath, y=int_32, Expression="Format(\"{0}, {1}\",  x,  y)")
xy_2 = XYPlane(Origin=item_39)
rad = Radians(Degrees=-90)
Y_2 = UnitY(Factor=-500)
X_2 = UnitX(Factor=-800)
rotate = Rotate(Geometry=xy_2, Angle=rad, Plane=xy_2)  # -> Geometry, Transform
addition_3 = Addition(A=Y_2, B=X_2)
move_11 = Move(Geometry=rotate.Geometry, Motion=addition_3)  # -> graft(Geometry), Transform
panel_7 = Panel(dpath)

crv_29 = Curve(join_2)
int_33 = Integer(44)
int_34 = Integer(191)
viewer_10 = ParamViewer(crv_29)
int_35 = Integer(0)
int_36 = Integer(147)
item_40 = ListItem(List=viewer_10, Index=int_33, Wrap=False)
item_41 = ListItem(List=viewer_10, Index=int_34, Wrap=False)
branch_19 = TreeBranch(Tree=crv_29, Path=item_40, MaintainPaths=True)
branch_20 = TreeBranch(Tree=crv_29, Path=item_41, MaintainPaths=True)
end_25 = EndPoints(Curve=branch_19)  # -> Start, End
end_26 = EndPoints(Curve=branch_20)  # -> Start, End
pt_16 = Point(end_25.Start)
pt_17 = Point(end_26.Start)
vec2pt_2 = Vector2Pt(PointA=pt_16, PointB=pt_17, Unitize=True)  # -> Vector, Length
Z_6 = UnitZ(Factor=1)
pl_6 = Plane(Origin=pt_16, XAxis=vec2pt_2.Vector, YAxis=Z_6)
project_7 = Project(Geometry=branch_19, Plane=pl_6)  # -> Geometry, Transform
project_8 = Project(Geometry=branch_20, Plane=pl_6)  # -> Geometry, Transform
merge_36 = Merge(Data1=project_7.Geometry, Data2=project_8.Geometry)  # -> flatten(Result)
join_4 = JoinCurves(Curves=merge_36, Preserve=False)  # -> simplify(Curves)
reb_4 = Rebuild(Curve=join_4, Count=10, Tangents=False)
eval_19 = EvaluateCurve(Curve=reb_4, Parameter=0)  # -> Point, Tangent, Angle
Z_7 = UnitZ(Factor=1)
xprod_7 = CrossProduct(VectorA=unitize(eval_19.Tangent), VectorB=Z_7, Unitize=True)  # -> Vector, Length
xprod_8 = CrossProduct(VectorA=xprod_7.Vector, VectorB=unitize(eval_19.Tangent), Unitize=False)  # -> Vector, Length
pl_7 = Plane(Origin=eval_19.Point, XAxis=xprod_7.Vector, YAxis=xprod_8.Vector)
rectangle_4 = Rectangle(Plane=pl_7, XSize=domain_2, YSize=domain, Radius=0)  # -> graft(Rectangle), Length
swp1_6 = Sweep1(Rail=graft(reb_4), Sections=rectangle_4.Rectangle, Miter=1)
cap_3 = CapHoles(Brep=swp1_6)

int_37 = Integer(int_26)
pshift_13 = ShiftPaths(Data=int_37, Offset=-1)  # -> graft(Data)
tstat_2 = TreeStatistics(Tree=pshift_13)  # -> Paths, Length, Count
replace_3 = ReplaceBranches(Data=pshift_13, Search=tstat_2.Paths, Replace=int_31)
dom_15 = Domain(DomainStart=domcomp.Start, DomainEnd=int_29)
dom_16 = Domain(DomainStart=int_29, DomainEnd=int_30)
dom_17 = Domain(DomainStart=int_30, DomainEnd=domcomp.End)
inc_4 = Includes(Value=replace_3, Domain=dom_15)  # -> Includes, Deviation
inc_5 = Includes(Value=replace_3, Domain=dom_16)  # -> Includes, Deviation
inc_6 = Includes(Value=replace_3, Domain=dom_17)  # -> Includes, Deviation

# ----
# SCHEDULE: RADII & LENGTH
offset_7 = Offset(Curve=arc_14, Distance=num_7, Plane=pln_2, Corners=1)  # -> simplify(Curve)
viewer_11 = ParamViewer(int_27)
len_4 = Length(Curve=offset_7)
dpath_2 = DecomposePath(Branch=viewer_11)
item_42 = ListItem(List=dpath_2, Index=0, Wrap=False)
item_43 = ListItem(List=dpath_2, Index=1, Wrap=False)
item_44 = ListItem(List=dpath_2, Index=2, Wrap=False)
int_38 = Integer(len_4)
concat = Concatenate(A=item_42, B=item_43)  # -> flatten(Result)
str = String(["01", "02", "03", "11", "12", "13", "21", "22", "23", "31", "32", "33"])
str_2 = String(["BC-1_", "CD-1_", "DE-1_", "BC-2_", "CD-2_", "DE-2_", "GH-2_", "FG-2_", "EF-2_", "GH-1_", "FG-1_", "EF-1_"])
rep = ReplaceString(String=flatten(concat), Find=graft(str), Replace=graft(str_2))
item_45 = ListItem(List=str_2, Index=0, Wrap=False)
len_5 = StringLength(String=rep)
len_6 = StringLength(String=item_45)
equals_3 = Equality(FirstNumber=len_5, SecondNumber=len_6)  # -> Equality, Inequality
cull_30 = CullPattern(List=rep, CullPattern=equals_3.Equality)  # -> graft(List)
viewer_12 = ParamViewer(cull_30)
viewer_13 = ParamViewer(item_44)
replace_4 = ReplaceBranches(Data=cull_30, Search=viewer_12, Replace=viewer_11)
replace_5 = ReplaceBranches(Data=item_44, Search=viewer_13, Replace=viewer_11)

concat_2 = Concatenate(A=replace_4, B=replace_5)

expression_2 = Expression(x=int_27, y=int_38, z=concat_2, Expression="Format(\"{0}, R={1}, L={2}\", z, x, y)")
panel_8 = Panel(expression_2)

eval_20 = EvaluateCurve(Curve=reparameterize(arc_14), Parameter=0.5)  # -> Point, Tangent, Angle
Z_8 = UnitZ(Factor=1)
int_39 = Integer(2000)
xprod_9 = CrossProduct(VectorA=unitize(eval_20.Tangent), VectorB=Z_8, Unitize=True)  # -> Vector, Length
amp_8 = Amplitude(Vector=eval_20.Tangent, Amplitude=int_39)
xprod_10 = CrossProduct(VectorA=xprod_9.Vector, VectorB=unitize(eval_20.Tangent), Unitize=False)  # -> Vector, Length
rev_6 = Reverse(Vector=amp_8)
panel_9 = Panel("{1;*;*}")
panel_10 = Panel("{2;*;*}")
move_12 = Move(Geometry=eval_20.Point, Motion=rev_6)  # -> Geometry, Transform
merge_37 = Merge(Data1="{0;*;*}", Data2="{3;*;*}")
pl_8 = Plane(Origin=move_12.Geometry, XAxis=eval_20.Tangent, YAxis=xprod_10.Vector)
tsplit = SplitTree(Data=pl_8, Masks=flatten(merge_37))  # -> Positive, Negative
tsplit_2 = SplitTree(Data=panel_8, Masks=flatten(merge_37))  # -> Positive, Negative
swatch_4 = ColourSwatch(SwatchColor=RGB(0, 0, 0))
swatch_5 = ColourSwatch(SwatchColor=RGB(0, 127, 255))
swatch_6 = ColourSwatch(SwatchColor=RGB(24, 158, 0))
int_40 = Integer(250)
tag = TextTag3D(Location=tsplit.Positive, Text=tsplit_2.Positive, Size=int_40, Colour=swatch_4)
tag_2 = TextTag3D(Location=tsplit.Negative, Text=tsplit_2.Negative, Size=int_40, Colour=swatch_4)

crv_30 = Curve(simplify(join_3))
vec_7 = VectorXYZ(XComponent=-120000, YComponent=-60000, ZComponent=0)  # -> Vector, Length
move_13 = Move(Geometry=crv_30, Motion=vec_7.Vector)  # -> Geometry, Transform
replace_6 = ReplaceBranches(Data=move_13.Geometry, Search=viewer_9, Replace=int_31)
int_41 = Integer(2500)
subtraction_4 = Subtraction(A=int_41, B=int_22)
tstat_3 = TreeStatistics(Tree=replace_6)  # -> Paths, Length, Count
series_8 = Series(Start=0, Step=subtraction_4, Count=tstat_3.Count)  # -> graft(Series)
tstat_4 = TreeStatistics(Tree=series_8)  # -> Paths, Length, Count
int_42 = Integer(400)
Z_9 = UnitZ(Factor=int_42)

move_14 = Move(Geometry=move_11.Geometry, Motion=vec_7.Vector)  # -> Geometry, Transform

# ----
# STEP 10
tag_3 = TextTag3D(Location=move_14.Geometry, Text=expression, Size=1000, Colour=ColourSwatch(SwatchColor=RGB(255, 255, 255)))

replace_7 = ReplaceBranches(Data=series_8, Search=tstat_4.Paths, Replace=tstat_3.Paths)

X_3 = UnitX(Factor=replace_7)
move_15 = Move(Geometry=replace_6, Motion=X_3)  # -> Geometry, Transform
len_7 = Length(Curve=move_15.Geometry)
sort = SortList(Keys=len_7, ValuesA=move_15.Geometry)  # -> Keys, ValuesA
rev_7 = ReverseList(List=sort.ValuesA)
lng_12 = ListLength(List=rev_7)
series_9 = Series(Start=0, Step=int_42, Count=lng_12)

tstat_5 = TreeStatistics(Tree=series_9)  # -> Paths, Length, Count
replace_8 = ReplaceBranches(Data=series_9, Search=tstat_5.Paths, Replace=tstat_3.Paths)

Z_10 = UnitZ(Factor=replace_8)
move_16 = Move(Geometry=rev_7, Motion=Z_10)  # -> Geometry, Transform
extr_8 = Extrude(Base=move_16.Geometry, Direction=Z_9)
cap_4 = CapHoles(Brep=extr_8)

cull_31 = CullPattern(List=cap_4, CullPattern=inc_4.Includes)
cull_32 = CullPattern(List=cap_4, CullPattern=inc_5.Includes)
cull_33 = CullPattern(List=cap_4, CullPattern=inc_6.Includes)
mesh_10 = MeshBrep(
    Brep=cap_4,
    Settings={Refine=True, JaggedSeams=False, SimplePlanes=True, GridMinCount=16, GridMaxCount=0, Tolerance=0, RefineAngle=0, MinTolerance=0, RelativeTolerance=0.65, MinEdgeLength=0.0001, MaxEdgeLength=0})
mesh_11 = MeshBrep(
    Brep=cull_32,
    Settings={Refine=True, JaggedSeams=False, SimplePlanes=True, GridMinCount=16, GridMaxCount=0, Tolerance=0, RefineAngle=0, MinTolerance=0, RelativeTolerance=0.65, MinEdgeLength=0.0001, MaxEdgeLength=0})
mesh_12 = MeshBrep(
    Brep=cull_31,
    Settings={Refine=True, JaggedSeams=False, SimplePlanes=True, GridMinCount=16, GridMaxCount=0, Tolerance=0, RefineAngle=0, MinTolerance=0, RelativeTolerance=0.65, MinEdgeLength=0.0001, MaxEdgeLength=0})
mesh_13 = MeshBrep(
    Brep=cull_33,
    Settings={Refine=True, JaggedSeams=False, SimplePlanes=True, GridMinCount=16, GridMaxCount=0, Tolerance=0, RefineAngle=0, MinTolerance=0, RelativeTolerance=0.65, MinEdgeLength=0.0001, MaxEdgeLength=0})
preview_9 = CustomPreview(Geometry=mesh_12, Shader=swatch)
preview_10 = CustomPreview(Geometry=mesh_11, Shader=swatch_2)
preview_11 = CustomPreview(Geometry=mesh_13, Shader=swatch_3)

# ==== cluster Cluster
A = ClusterInput()
B = ClusterInput()
A_2 = ClusterInput()
B_2 = ClusterInput()
dist = Distance(PointA=A, PointB=flatten(B))
dist_2 = Distance(PointA=A_2, PointB=B_2)
larger = LargerThan(FirstNumber=dist_2, SecondNumber=dist)  # -> simplify(graft(LargerThan)), OrEqualTo
L = ClusterInput()
L_2 = ClusterInput()
dispatch = Dispatch(List=simplify(graft(L)), DispatchPattern=larger.LargerThan)  # -> ListA, ListB
dispatch_2 = Dispatch(List=L_2, DispatchPattern=larger.LargerThan)  # -> ListA, ListB
merge = Merge(Data1=dispatch.ListA, Data2=dispatch_2.ListB)
R = ClusterOutput(merge)

# ==== cluster Cluster_2
A = ClusterInput()
B = ClusterInput()
A_2 = ClusterInput()
B_2 = ClusterInput()
dist = Distance(PointA=A, PointB=flatten(B))
dist_2 = Distance(PointA=A_2, PointB=B_2)
L = ClusterInput()
larger = LargerThan(FirstNumber=dist_2, SecondNumber=dist)  # -> simplify(graft(LargerThan)), OrEqualTo
L_2 = ClusterInput()
dispatch = Dispatch(List=simplify(graft(L)), DispatchPattern=larger.LargerThan)  # -> ListA, ListB
dispatch_2 = Dispatch(List=L_2, DispatchPattern=larger.LargerThan)  # -> ListA, ListB
merge = Merge(Data1=dispatch.ListA, Data2=dispatch_2.ListB)
R = ClusterOutput(merge)

# ==== cluster Cluster_3
I = ClusterInput()
L = ClusterInput()
null = NullItem(Item=I)  # -> flatten(NullFlags), InvalidFlags, Description
T = ClusterInput()
T_2 = ClusterInput()
dispatch = Dispatch(List=L, DispatchPattern=null.NullFlags)  # -> ListA, ListB
i = ClusterInput()
branch = TreeBranch(Tree=T, Path=dispatch.ListA, MaintainPaths=True)
branch_2 = TreeBranch(Tree=T_2, Path=dispatch.ListB, MaintainPaths=True)
ins = ListInsert(List=branch, Indices=i, Wrap=False)  # -> simplify(List)
merge = Merge(Data1=ins, Data2=branch_2)
pshift = ShiftPaths(Data=merge, Offset=-1)
D = ClusterOutput(pshift)
